# Grasshopper definition Soil Import component.gh (Grasshopper 1.0.8)

# ---- group: Location Picker
# Pick lets you pick the location without manually having to type in the lon and lat
button = Button()
location_picker = Python3Script(pick=button)  # -> lat, lon
# ---------- location_picker: Python ----------
import re
import Rhino
import scriptcontext as sc
import Eto.Forms as ef
import Eto.Drawing as ed

KEY = "soil_map_pick"

HTML = """
<!DOCTYPE html>
<html>
<head>
<meta charset="utf-8">
<title>map</title>
<link rel="stylesheet" href="https://cdnjs.cloudflare.com/ajax/libs/leaflet/1.9.4/leaflet.css"/>
<script src="https://cdnjs.cloudflare.com/ajax/libs/leaflet/1.9.4/leaflet.js"></script>
<style>
  html, body { margin:0; height:100%; font-family:Segoe UI, Arial, sans-serif; }
  #bar { height:48px; display:flex; align-items:center; gap:12px; padding:0 12px; background:#f0f0f0; }
  #map { height:calc(100% - 48px); }
  button { padding:6px 14px; font-size:14px; }
</style>
</head>
<body>
<div id="bar">
  <span id="info">Click on the map to place a marker</span>
  <button onclick="confirmPick()">Use this location</button>
</div>
<div id="map"></div>
<script>
  var map = L.map('map').setView([START_LAT, START_LON], START_ZOOM);
  L.tileLayer('https://server.arcgisonline.com/ArcGIS/rest/services/World_Imagery/MapServer/tile/{z}/{y}/{x}',
              {maxZoom: 18, attribution: 'Esri'}).addTo(map);
  var marker = null, pos = null;
  map.on('click', function(e) {
    pos = e.latlng;
    if (marker) { marker.setLatLng(pos); } else { marker = L.marker(pos).addTo(map); }
    document.getElementById('info').innerText =
      'lat ' + pos.lat.toFixed(5) + '   lon ' + pos.lng.toFixed(5);
  });
  function confirmPick() {
    if (!pos) { document.getElementById('info').innerText = 'Click the map first'; return; }
    document.title = 'PICK:' + pos.lat.toFixed(5) + ',' + pos.lng.toFixed(5);
  }
</script>
</body>
</html>
"""

def pick_location(lat0, lon0):
    result = {}
    if lat0 is not None and lon0 is not None:
        html = (HTML.replace("START_LAT", str(float(lat0)))
                    .replace("START_LON", str(float(lon0)))
                    .replace("START_ZOOM", "6"))
    else:
        html = (HTML.replace("START_LAT", "20")
                    .replace("START_LON", "0")
                    .replace("START_ZOOM", "2"))

    dlg = ef.Dialog()
    dlg.Title = "Pick a location"
    dlg.ClientSize = ed.Size(950, 700)
    dlg.Resizable = True

    web = ef.WebView()

    def on_title(sender, e):
        title = str(e.Title)
        if title.startswith("PICK:"):
            nums = re.findall(r"-?\d+\.?\d*", title)
            if len(nums) >= 2:
                result["lat"] = float(nums[0])
                result["lon"] = float(nums[1])
            dlg.Close()

    web.DocumentTitleChanged += on_title
    web.LoadHtml(html)
    dlg.Content = web
    dlg.ShowModal(Rhino.UI.RhinoEtoApp.MainWindow)

    if "lat" in result:
        return (result["lat"], result["lon"])
    return None

# Open the map when the button is pressed
if pick:
    picked = pick_location(lat0, lon0)
    if picked:
        sc.sticky[KEY] = picked

# Always output the last picked location
saved = sc.sticky.get(KEY)
if saved:
    lat, lon = saved
else:
    lat, lon = None, None
# ---------- end location_picker ----------

# ---- group: Soil Extraction
# Inputs: run, lat, lon
# Outputs: texture, bulk density, available water capacity, conductivity, hydrologic group, clay/silt/sand percentages, and the soil_valid flag
toggle = BooleanToggle(True)
soil_extraction = Python3Script(run=toggle, lat=location_picker.lat, lon=location_picker.lon)  # -> soil, texture, bd1, awc1, k1, hydgrp, clay1, silt1, sand1, soil_valid; inputs run: Boolean, lat: Double, lon: Double
# ---------- soil_extraction: Python ----------
import json
import urllib.request

SUPABASE_URL = "https://widpcrwshasvkaudybjv.supabase.co"
SUPABASE_KEY = "sb_publishable_nnucQOoiBqRPhgjhAAuEbQ_nQJMFkX-"

def fetch_soil(lat, lon):
    url = SUPABASE_URL + "/rest/v1/rpc/get_soil"
    headers = {
        "apikey": SUPABASE_KEY,
        "Content-Type": "application/json",
        "User-Agent": "soil-plugin",
    }
    if SUPABASE_KEY.startswith("eyJ"):
        headers["Authorization"] = "Bearer " + SUPABASE_KEY
    body = json.dumps({"lat": float(lat), "lon": float(lon)}).encode("utf-8")
    try:
        req = urllib.request.Request(url, data=body, headers=headers, method="POST")
        with urllib.request.urlopen(req, timeout=15) as resp:
            return json.loads(resp.read().decode("utf-8"))
    except Exception as e:
        print(f"Soil lookup error: {e}")
        return None

# Component Execution Logic
if run and lat is not None and lon is not None:
    data = fetch_soil(lat, lon)

    if data:
        texture = str(data.get("TEXTURE") or "N/A")
        bd1  = float(data.get("SOL_BD1") or 0.0)
        awc1 = float(data.get("SOL_AWC1") or 0.0)
        k1   = float(data.get("SOL_K1") or 0.0)
        hydgrp = str(data.get("HYDGRP") or "N/A")
        country = str(data.get("COUNTRY") or "N/A")
        clay1 = float(data.get("CLAY1") or 0.0)
        silt1 = float(data.get("SILT1") or 0.0)
        sand1 = float(data.get("SAND1") or 0.0)

        non_soil = texture in ("UWB", "N/A") or k1 >= 99
        soil_valid = not non_soil

        soil = f"Location: {country}\nTexture: {texture}\nHydgrp: {hydgrp}\nBulk Density: {bd1}"
    else:
        soil = "No soil polygon found at coordinates."
        texture, bd1, awc1, k1, hydgrp = "N/A", 0.0, 0.0, 0.0, "N/A"
        clay1, silt1, sand1 = 0.0, 0.0, 0.0
        soil_valid = False
else:
    soil = "Set 'run' to True and provide lat/lon."
    texture, bd1, awc1, k1, hydgrp = "N/A", 0.0, 0.0, 0.0, "N/A"
    clay1, silt1, sand1 = 0.0, 0.0, 0.0
    soil_valid = False
# ---------- end soil_extraction ----------
panel = Panel(soil_extraction.soil)
panel_2 = Panel(soil_extraction.bd1)
panel_3 = Panel(soil_extraction.texture)
panel_4 = Panel(soil_extraction.awc1)
panel_5 = Panel(soil_extraction.k1)
panel_6 = Panel(soil_extraction.hydgrp)
panel_7 = Panel(soil_extraction.clay1)
panel_8 = Panel(soil_extraction.silt1)
panel_9 = Panel(soil_extraction.sand1)
panel_10 = Panel(soil_extraction.soil_valid)

# ---- group: fetch
fetch = Python3Script(fetch=Button())  # -> json_text, status; inputs fetch: Boolean
# ---------- fetch: Python ----------
# ============================================================================
# COMPONENT 1: FETCH  (Rhino 7 GhPython or Rhino 8 Python 3 Script)
#
# Inputs   fetch  bool  Item   <- connect a Boolean Toggle or Button
#          url    str   Item   <- the "verified only" (or "everything") URL from the app's Settings tab
# Outputs  json_text  <- connect to components 2, 3 and 4
#          status
#
# Press the button: downloads the catalogue from Supabase and keeps a copy in memory and in
# a local cache file, so the other components keep working when you let go and after Rhino restarts.
# ============================================================================
import json, time
import scriptcontext as sc
from System.IO import File, Path
from System.Net import WebClient, ServicePointManager, SecurityProtocolType
from System.Text import Encoding

STICKY = "earth_catalogue_json"
CACHE = Path.Combine(Path.GetTempPath(), "earth_catalogue_cache.json")
CATALOGUE_URL = "https://widpcrwshasvkaudybjv.supabase.co/storage/v1/object/public/catalogue/earth_materials_catalogue_verified.json"


def describe(txt, prefix):
    d = json.loads(txt)
    return "%s: %d materials (exported %s)" % (prefix, len(d.get("materials", [])), str(d.get("exported_at", "?"))[:19])


json_text = sc.sticky.get(STICKY)
status = "Press the button to download the catalogue."
url = globals().get("url") or CATALOGUE_URL
try:
    if fetch:
        try:
            ServicePointManager.SecurityProtocol = SecurityProtocolType.Tls12   # needed on older .NET
        except Exception:
            pass
        wc = WebClient()
        wc.Encoding = Encoding.UTF8
        sep = "&" if "?" in url else "?"
        txt = wc.DownloadString(url + sep + "t=" + str(int(time.time())))     # t= defeats CDN caching
        d = json.loads(txt)
        if d.get("schema") != "earth_materials_catalogue":
            raise Exception("That URL did not return a catalogue export file.")
        sc.sticky[STICKY] = txt
        File.WriteAllText(CACHE, txt, Encoding.UTF8)
        json_text = txt
        status = describe(txt, "Downloaded")
    elif json_text:
        status = describe(json_text, "Using last download")
    elif File.Exists(CACHE):
        json_text = File.ReadAllText(CACHE, Encoding.UTF8)
        sc.sticky[STICKY] = json_text
        status = describe(json_text, "Loaded from local cache")
except Exception as e:
    status = "ERROR: " + str(e)
# ---------- end fetch ----------
panel_11 = Panel(fetch.json_text)
panel_12 = Panel(fetch.status)

# ---- group: decode
py3 = Python3Script(json_text=fetch.json_text)  # -> n, ids, names, techniques, methods_present, clay, decode, sand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
# ---------- py3: Python ----------
# ============================================================================
# COMPONENT 2: DECODE
#
# Inputs   json_text  str  Item   <- from component 1
# Outputs  n, ids, names, techniques, methods_present,
#          clay, silt, sand, gravel, texture, soil_source, match_ready,
#          rho, lam, cp, fc, ff, verified, doi, year
#
# Every list is in the same order: item 7 of 'names' goes with item 7 of 'lam', 'fc', 'clay', ...
# A missing value comes out as null. 'techniques' is the construction-method tag(s), e.g. "3d_printed".
# ============================================================================
import json

data = json.loads(json_text) if json_text else {}
mats = data.get("materials", [])


def prop(m, k):
    return (m.get("properties") or {}).get(k)


def soil(m, k):
    return (m.get("soil") or {}).get(k)


n = len(mats)
ids = [m.get("id") for m in mats]
names = [m.get("name") for m in mats]
techniques = [", ".join(m.get("techniques") or []) for m in mats]

counts = {}
for m in mats:
    for t in (m.get("techniques") or []):
        counts[t] = counts.get(t, 0) + 1
methods_present = ["%s (%d)" % (t, counts[t]) for t in sorted(counts)]

clay = [soil(m, "clay_pct") for m in mats]
silt = [soil(m, "silt_pct") for m in mats]
sand = [soil(m, "sand_pct") for m in mats]
gravel = [soil(m, "gravel_pct") for m in mats]
texture = [soil(m, "texture_class") for m in mats]
soil_source = [soil(m, "source") for m in mats]
match_ready = [bool(soil(m, "match_ready")) for m in mats]

rho = [prop(m, "dry_density_kg_m3") for m in mats]
lam = [prop(m, "thermal_conductivity_W_mK") for m in mats]
cp = [prop(m, "specific_heat_J_kgK") for m in mats]
fc = [prop(m, "compressive_strength_MPa") for m in mats]
ff = [prop(m, "flexural_strength_MPa") for m in mats]

verified = [bool(m.get("fully_verified")) for m in mats]
doi = [(m.get("source") or {}).get("doi") for m in mats]
year = [(m.get("source") or {}).get("year") for m in mats]
# ---------- end py3 ----------
panel_13 = Panel(py3.ids)
panel_14 = Panel(py3.names)
panel_15 = Panel(py3.techniques)
panel_16 = Panel(py3.sand)
panel_17 = Panel(py3.doi)
panel_18 = Panel(py3.clay)

# ---- group: list_by_method
list = ValueList({"3D printed": "3d_printed", "Cob": "cob", "Adobe": "adobe", "Rammed earth": "rammed_earth", "Compressed earth block": "compressed_earth_block", "Cast earth": "cast_earth", "Wattle and daub": "wattle_and_daub", "Earthbag": "earthbag", "Other": "other"}, selected="3D printed")
list_by_method = Python3Script(json_text=fetch.json_text, method=list)  # -> ids, names, techniques, clay, silt, sand, match_ready, rho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; inputs json_text: String, method: String, only_verified: Boolean
# ---------- list_by_method: Python ----------
# ============================================================================
# COMPONENT 3: LIST BY CONSTRUCTION METHOD
#
# Inputs   json_text  str  Item   <- from component 1
#          method     str  Item   <- from a Value List (see README): 3d_printed, cob, adobe, rammed_earth,
#                                    compressed_earth_block, cast_earth, wattle_and_daub, earthbag, other
#                                    leave empty or use "all" for no filter
#          only_verified  bool Item (optional)  True = only fully audited records
# Outputs  count, names, ids, techniques, lam, fc, rho, clay, silt, sand, match_ready, verified, doi, report
# ============================================================================
import json

# optional inputs may not exist on the component, or may be unconnected
only_verified = globals().get("only_verified")

data = json.loads(json_text) if json_text else {}
mats = data.get("materials", [])


def norm(t):
    return str(t or "").strip().lower().replace(" ", "_").replace("-", "_").replace("/", "_")


want = norm(method)
if want in ("", "all", "any"):
    want = None

picked = []
for m in mats:
    if want and want not in [norm(t) for t in (m.get("techniques") or [])]:
        continue
    if only_verified and not m.get("fully_verified"):
        continue
    picked.append(m)


def prop(m, k):
    return (m.get("properties") or {}).get(k)


def soil(m, k):
    return (m.get("soil") or {}).get(k)


count = len(picked)
names = [m.get("name") for m in picked]
ids = [m.get("id") for m in picked]
techniques = [", ".join(m.get("techniques") or []) for m in picked]
lam = [prop(m, "thermal_conductivity_W_mK") for m in picked]
fc = [prop(m, "compressive_strength_MPa") for m in picked]
rho = [prop(m, "dry_density_kg_m3") for m in picked]
clay = [soil(m, "clay_pct") for m in picked]
silt = [soil(m, "silt_pct") for m in picked]
sand = [soil(m, "sand_pct") for m in picked]
match_ready = [bool(soil(m, "match_ready")) for m in picked]
verified = [bool(m.get("fully_verified")) for m in picked]
doi = [(m.get("source") or {}).get("doi") for m in picked]

if not mats:
    report = "No catalogue loaded. Press the fetch button in component 1."
else:
    report = "%s: %d of %d materials%s. %d have a soil composition usable for matching, %d are fully verified." % (
        want or "all methods", count, len(mats), " (verified only)" if only_verified else "",
        sum(match_ready), sum(verified))
    if want and count == 0:
        present = sorted(set(norm(t) for m in mats for t in (m.get("techniques") or [])))
        report += " Methods in this catalogue: " + ", ".join(present)
# ---------- end list_by_method ----------
panel_19 = Panel(list_by_method.names)
panel_20 = Panel(list_by_method.techniques)
panel_21 = Panel(list_by_method.clay)
panel_22 = Panel(list_by_method.report)

# ----
list_2 = ValueList({"Mechanical": "mechanical", "Thermal": "thermal", "All": ""}, selected="Mechanical")

# ---- group: match
list_3 = ValueList({"3D printed": "3d_printed", "Cob": "cob", "Adobe": "adobe", "Rammed earth": "rammed_earth", "Compressed earth block": "compressed_earth_block", "Cast earth": "cast_earth", "Wattle and daub": "wattle_and_daub", "Earthbag": "earthbag", "Other": "other"}, selected="Rammed earth")
match = Python3Script(
    json_text=fetch.json_text,
    method=list_3,
    site_clay=soil_extraction.clay1,
    site_silt=soil_extraction.silt1,
    site_sand=soil_extraction.sand1,
    domain=list_2)  # -> best, names, ids, match_pct, texture, soil_source, lam, fc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; inputs json_text: String, method: String, site_clay: Double, site_silt: Double, site_sand: Double, only_verified: Boolean, min_fc: Double, max_lambda: Double, top_n: Int32, domain: String, allow_estimates: Boolean
# ---------- match: Python ----------
# ============================================================================
# COMPONENT 4: MATCH SITE SOIL TO CATALOGUE
#
# Inputs   json_text   str    Item   <- from component 1
#          method      str    Item   <- construction method (same Value List as component 3)
#          site_clay   float  Item   <- the region's soil, % clay      (from your soil extraction: clay1)
#          site_silt   float  Item   <- % silt                          (silt1)
#          site_sand   float  Item   <- % sand                          (sand1)
#          only_verified bool  Item (optional)  True = only fully audited records
#          min_match   float  Item (optional)  hide matches below this % (e.g. 60)
#          min_fc      float  Item (optional)  discard materials weaker than this compressive strength (MPa)
#          max_lambda  float  Item (optional)  discard materials more conductive than this (W/m.K)
#          top_n       int    Item (optional)  how many to return, default 5
#          domain      str    Item (optional)  "mechanical" (Karamba) or "thermal" (Honeybee): keep only materials
#                                              with the minimum data for that tool (see 06 / 07)
#          allow_estimates bool Item (optional) with domain: also accept materials complete only through estimates
# Outputs  best, names, ids, match_pct, correction, texture, soil_source, lam, fc, rho, verified, doi, report
#
# best        the COMPLETE record of the best match as JSON text (same format as the catalogue file,
#             plus a "match" block with match_pct, correction and your site soil). Feed it to
#             component 5 (05_decode_best.py) to get every property, the recipe, curing, source...
#             Component 2 also reads it. It is empty (null) when nothing matched.
#             The other outputs are lists for the top_n results, closest first, lined up by position.
#
# match_pct   100 = the site soil is identical to the soil recipe in the paper.
#             Both soils are rescaled to clay+silt+sand = 100. The match is the share of the soil
#             that already agrees, so 60 means 40 % of the soil would have to be swapped.
#             Gravel is ignored. It compares soil texture only, not clay mineralogy or additives
#             (fibre, stabiliser, water), so use it to shortlist and then read the paper.
# correction  what to do to the site soil to reach that recipe, in percentage points of the soil,
#             e.g. "clay +3 / silt -10 / sand +7" (+ = needs more of it, - = needs less).
# ============================================================================
import json

# optional inputs may not exist on the component, or may be unconnected
only_verified = globals().get("only_verified")
min_match = globals().get("min_match")
min_fc = globals().get("min_fc")
max_lambda = globals().get("max_lambda")
top_n = globals().get("top_n")
domain = globals().get("domain")
allow_estimates = globals().get("allow_estimates")

data = json.loads(json_text) if json_text else {}
mats = data.get("materials", [])


def norm(t):
    return str(t or "").strip().lower().replace(" ", "_").replace("-", "_").replace("/", "_")


def three(c, s, a):
    """rescale clay/silt/sand to sum to 100"""
    tot = float(c) + float(s) + float(a)
    if tot <= 0:
        return None
    return (c * 100.0 / tot, s * 100.0 / tot, a * 100.0 / tot)


def prop(m, k):
    return (m.get("properties") or {}).get(k)


best, names, ids, match_pct, correction, texture, soil_source = None, [], [], [], [], [], []
lam, fc, rho, verified, doi = [], [], [], [], []
report = ""

site = None
if site_clay is not None and site_silt is not None and site_sand is not None:
    site = three(site_clay, site_silt, site_sand)

if not mats:
    report = "No catalogue loaded. Press the fetch button in component 1."
elif site is None:
    report = "Give the site's clay, silt and sand percentages."
else:
    want = norm(method)
    if want in ("", "all", "any"):
        want = None
    n_top = int(top_n) if top_n else 5
    dom = norm(domain) or None
    ok_levels = ("ready", "estimated") if allow_estimates else ("ready",)
    drops = {"other method": 0, "not %s data" % dom: 0, "%s data incomplete" % dom: 0, "no soil data": 0,
             "not verified": 0, "too weak": 0, "too conductive": 0, "below min match": 0}
    scored = []
    no_soil_names = []    # right method, but the paper gave no clay/silt/sand
    for m in mats:
        if want and want not in [norm(t) for t in (m.get("techniques") or [])]:
            drops["other method"] += 1
            continue
        if dom:
            r = (m.get("readiness") or {}).get(dom)
            if not r:
                drops["not %s data" % dom] += 1
                continue
            if r.get("level") not in ok_levels:
                drops["%s data incomplete" % dom] += 1
                continue
        s = m.get("soil") or {}
        if not s.get("match_ready"):
            drops["no soil data"] += 1
            no_soil_names.append(m.get("name"))
            continue
        if only_verified and not m.get("fully_verified"):
            drops["not verified"] += 1
            continue
        v_fc, v_lam = prop(m, "compressive_strength_MPa"), prop(m, "thermal_conductivity_W_mK")
        if min_fc is not None and (v_fc is None or v_fc < min_fc):
            drops["too weak"] += 1
            continue
        if max_lambda is not None and (v_lam is None or v_lam > max_lambda):
            drops["too conductive"] += 1
            continue
        t = three(s["clay_pct"], s["silt_pct"], s["sand_pct"])
        if t is None:
            drops["no soil data"] += 1
            no_soil_names.append(m.get("name"))
            continue
        delta = [a - b for a, b in zip(t, site)]            # change needed: site soil -> recipe soil
        match = 100.0 - 0.5 * sum(abs(x) for x in delta)    # 100 = identical
        if min_match is not None and match < min_match:
            drops["below min match"] += 1
            continue
        scored.append((match, delta, m))
    scored.sort(key=lambda x: -x[0])
    scored = scored[:n_top]

    names = [m.get("name") for mt, dl, m in scored]
    ids = [m.get("id") for mt, dl, m in scored]
    match_pct = [round(mt, 1) for mt, dl, m in scored]
    correction = ["clay %+d / silt %+d / sand %+d" % tuple(int(round(x)) for x in dl) for mt, dl, m in scored]
    texture = [(m.get("soil") or {}).get("texture_class") for mt, dl, m in scored]
    soil_source = [(m.get("soil") or {}).get("source") for mt, dl, m in scored]
    lam = [prop(m, "thermal_conductivity_W_mK") for mt, dl, m in scored]
    fc = [prop(m, "compressive_strength_MPa") for mt, dl, m in scored]
    rho = [prop(m, "dry_density_kg_m3") for mt, dl, m in scored]
    verified = [bool(m.get("fully_verified")) for mt, dl, m in scored]
    doi = [(m.get("source") or {}).get("doi") for mt, dl, m in scored]
    if scored:
        rec = dict(scored[0][2])
        rec["match"] = {"match_pct": match_pct[0], "correction": correction[0],
                        "site_clay": round(site[0], 1), "site_silt": round(site[1], 1), "site_sand": round(site[2], 1),
                        "method": want or "all"}
        best = json.dumps({"schema": data.get("schema"), "version": data.get("version"),
                           "count": 1, "materials": [rec]}, ensure_ascii=False)

    lines = ["Site soil (rescaled): clay %.0f / silt %.0f / sand %.0f %%" % site,
             "Method: %s" % (want or "all")]
    if dom:
        lines.append("Domain: %s (%s)" % (dom, "ready or estimated" if allow_estimates else "ready only"))
    if scored:
        lines.append("Best: %s, %.0f%% match" % (names[0], match_pct[0]))
        lines.append("To reach its soil: %s (points of the soil)" % correction[0])
        if any(s_ == "computed_from_composition" for s_ in soil_source):
            lines.append("Note: some soil values were computed from the recipe, not measured soil. Check the source paper.")
    else:
        lines.append("No candidates left.")
    if no_soil_names:
        lines.append("%d material(s) use this method but have no soil composition, so they cannot be matched "
                     "(see component 3): %s" % (len(no_soil_names), "; ".join(str(n) for n in no_soil_names)))
    lines.append("Left out: " + ", ".join("%d %s" % (v, k) for k, v in drops.items() if v) if any(drops.values()) else "Nothing left out.")
    report = "\n".join(lines)
# ---------- end match ----------
panel_23 = Panel(match.best)
panel_24 = Panel(match.names)
panel_25 = Panel(match.match_pct)
panel_26 = Panel(match.correction)

# ---- group: decode_best
decode_best = Python3Script(best=match.best)  # -> fc, ft, ff, E, lam, cp, alpha, vhc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
# ---------- decode_best: Python ----------
# ============================================================================
# COMPONENT 5: DECODE THE BEST MATCH  ->  mechanical + thermal properties
#
# Input    best  str  Item   <- the 'best' output of component 4
#
# Outputs  each one is a single value (not a list), because it is one material. null = not reported in the paper.
#
#   WHICH        name, id, techniques, match_pct, correction, verified, doi
#   MECHANICAL   fc    compressive strength, MPa     ft   tensile strength, MPa
#                ff    flexural strength, MPa        E    elastic modulus, MPa
#   THERMAL      lam   conductivity, W/mK            cp   specific heat, J/kgK
#                alpha diffusivity, mm2/s            vhc  volumetric heat capacity, MJ/m3K
#                dec   decrement factor, -           lag  time lag, h
#   PHYSICAL     rho   dry density, kg/m3            por  porosity, %
#   HYGRIC       shr   drying shrinkage, %           wabs water absorption, %
#   SOIL         clay, silt, sand, gravel (% of the material's own soil), texture
#   CHECK        missing   the mechanical/thermal/physical properties that have no value for this material
#
# Poisson's ratio is not stored in the catalogue, so it is not available here.
# ============================================================================
import json

rec = None
if best:
    d = json.loads(best)
    if isinstance(d, dict) and d.get("materials"):
        rec = d["materials"][0]
    elif isinstance(d, dict) and "name" in d:
        rec = d

P = (rec or {}).get("properties") or {}
S = (rec or {}).get("soil") or {}
M = (rec or {}).get("match") or {}
SRC = (rec or {}).get("source") or {}

# ---- which
name = (rec or {}).get("name")
id = (rec or {}).get("id")
techniques = ", ".join((rec or {}).get("techniques") or [])
match_pct = M.get("match_pct")
correction = M.get("correction")
verified = bool((rec or {}).get("fully_verified"))
doi = SRC.get("doi")

# ---- mechanical
fc = P.get("compressive_strength_MPa")
ft = P.get("tensile_strength_MPa")
ff = P.get("flexural_strength_MPa")
E = P.get("elastic_modulus_MPa")

# ---- thermal
lam = P.get("thermal_conductivity_W_mK")
cp = P.get("specific_heat_J_kgK")
alpha = P.get("thermal_diffusivity_mm2_s")
vhc = P.get("volumetric_heat_capacity_MJ_m3K")
dec = P.get("decrement_factor")
lag = P.get("time_lag_h")

# ---- physical / hygric
rho = P.get("dry_density_kg_m3")
por = P.get("porosity_pct")
shr = P.get("shrinkage_pct")
wabs = P.get("water_absorption_pct")

# ---- soil
clay, silt, sand, gravel = S.get("clay_pct"), S.get("silt_pct"), S.get("sand_pct"), S.get("gravel_pct")
texture = S.get("texture_class")

# ---- which of the analysis properties are empty
wanted = [("fc", fc), ("ft", ft), ("ff", ff), ("E", E), ("lam", lam), ("cp", cp), ("alpha", alpha),
          ("vhc", vhc), ("dec", dec), ("lag", lag), ("rho", rho), ("por", por)]
missing = [k for k, v in wanted if v is None] if rec else ["No best match. Connect the 'best' output of component 4."]
# ---------- end decode_best ----------
panel_27 = Panel(decode_best.ff)
panel_28 = Panel(decode_best.rho)
panel_29 = Panel(decode_best.shr)
panel_30 = Panel(decode_best.fc)

# ----
panel_31 = Panel(decode_best.E)
panel_32 = Panel(decode_best.por)

# ---- group: Mechanical
karamba_material = Python3Script(best=match.best, allow_estimates=Toggle(True))  # -> E, G, gamma, fc, ft, ready, assumptions, report; inputs best: String, nu: Double, allow_estimates: Boolean
# ---------- karamba_material: Python ----------
# ============================================================================
# COMPONENT 6: KARAMBA MATERIAL FROM THE BEST MATCH  (mechanical domain)
#
# Inputs   best             str    Item   <- the 'best' output of component 4 (use domain = "mechanical" there)
#          nu               float  Item (optional)  Poisson's ratio to ASSUME when the paper gives none, default 0.2
#          allow_estimates  bool   Item (optional)  True = also use values the catalogue only estimated
# Outputs  name, E, G, gamma, alphaT, ft, fc, ready, assumptions, report
#
# Wire into Karamba's material component (Karamba units):
#   E       Young's modulus      kN/cm2   = elastic modulus MPa / 10
#   G       shear modulus        kN/cm2   = E / (2 (1 + nu)), nu from the paper if reported, else the assumed nu
#   gamma   specific weight      kN/m3    = dry density kg/m3 x 9.81 / 1000
#   alphaT  thermal expansion    1/C      not in the catalogue (earth papers almost never report it): always null.
#                                         Only matters for temperature loads; otherwise leave Karamba's input empty.
#   ft      tensile strength     kN/cm2   = tensile strength MPa / 10, null if not reported
#   fc      compressive strength kN/cm2   = compressive strength MPa / 10 (positive; older Karamba with a single
#                                         'fy' input: use fc. If your Karamba version expects fc negative, use -fc)
#
# ready = E, fc and gamma all come from the paper (reported or calculated from its data).
# assumptions lists every value that does not come from the paper. Never wire a null into Karamba.
# ============================================================================
import json

nu_in = globals().get("nu")
allow_estimates = globals().get("allow_estimates")

rec = None
if best:
    d = json.loads(best)
    if isinstance(d, dict) and d.get("materials"):
        rec = d["materials"][0]
    elif isinstance(d, dict) and "name" in d:
        rec = d

P = (rec or {}).get("properties") or {}
B = (rec or {}).get("property_basis") or {}
OK = ("reported", "manual", "derived", "estimated") if allow_estimates else ("reported", "manual", "derived")
assumptions = []


def get(k):
    """value only if its basis is acceptable; estimated values are noted"""
    v = P.get(k)
    if v is None or B.get(k, "reported") not in OK:
        return None
    if B.get(k) == "estimated":
        assumptions.append("%s is an ESTIMATE, not from the paper" % k)
    return v


name = (rec or {}).get("name")
E_mpa, fc_mpa, ft_mpa = get("elastic_modulus_MPa"), get("compressive_strength_MPa"), get("tensile_strength_MPa")
rho = get("dry_density_kg_m3")
nu_paper = get("poisson_ratio")

E = round(E_mpa / 10.0, 3) if E_mpa is not None else None
fc = round(fc_mpa / 10.0, 4) if fc_mpa is not None else None
ft = round(ft_mpa / 10.0, 4) if ft_mpa is not None else None
gamma = round(rho * 9.81 / 1000.0, 3) if rho is not None else None
alphaT = None

if nu_paper is not None:
    nu_used = nu_paper
else:
    nu_used = float(nu_in) if nu_in is not None else 0.2
    if E is not None:
        assumptions.append("Poisson's ratio %.2f ASSUMED (not reported), used for G" % nu_used)
G = round(E / (2.0 * (1.0 + nu_used)), 3) if E is not None else None

ready = rec is not None and None not in (E, fc, gamma) and not any(
    B.get(k) == "estimated" for k in ("elastic_modulus_MPa", "compressive_strength_MPa", "dry_density_kg_m3"))

lines = []
if rec is None:
    lines.append("No material. Connect the 'best' output of component 4.")
else:
    r = ((rec.get("readiness") or {}).get("mechanical") or {})
    lines.append("%s  (catalogue: mechanical %s)" % (name, r.get("level", "no mechanical data")))
    for label, v, unit in (("E", E, "kN/cm2"), ("G", G, "kN/cm2"), ("gamma", gamma, "kN/m3"),
                           ("ft", ft, "kN/cm2"), ("fc", fc, "kN/cm2")):
        lines.append("  %-6s %s" % (label, "%s %s" % (v, unit) if v is not None else "MISSING"))
    lines.append("  alphaT not reported: leave Karamba's input empty unless you apply temperature loads")
    if ft is None:
        lines.append("  ft not reported: earth carries almost no tension; set it yourself if your analysis needs it")
    lines.append("READY for Karamba" if ready else
                 ("Usable for Karamba WITH estimates" if None not in (E, fc, gamma) else "NOT ready: E, fc and gamma are all needed"))
    if assumptions:
        lines.append("Assumptions:")
        lines.extend("  - " + a for a in assumptions)
report = "\n".join(lines)
# ---------- end karamba_material ----------
panel_33 = Panel(karamba_material.G)
panel_34 = Panel(karamba_material.gamma)
panel_35 = Panel(karamba_material.E)
panel_36 = Panel(karamba_material.fc)
panel_37 = Panel(karamba_material.ft)
panel_38 = Panel(karamba_material.ready)
panel_39 = Panel(karamba_material.assumptions)
panel_40 = Panel(karamba_material.report)

# ---- group: Thermal
thermal = Python3Script(best=match.best, thickness=Slider(0.4, range=0..1), allow_estimates=Toggle(True))  # -> name, thickness_m, conductivity, density, spec_heat, ready, assumptions, report, material; inputs best: String, thickness: Double, cp: Double, allow_estimates: Boolean
# ---------- thermal: Python ----------
# ============================================================================
# COMPONENT 7: HONEYBEE MATERIAL FROM THE BEST MATCH  (thermal domain)
#
# Inputs   best             str    Item   <- the 'best' output of component 4 (use domain = "thermal" there)
#          thickness        float  Item   wall layer thickness in METRES (your design, not from the paper)
#          cp               float  Item (optional)  specific heat J/kgK to ASSUME when the paper gives none
#          allow_estimates  bool   Item (optional)  True = also use values the catalogue only estimated
# Outputs  name, thickness_m, conductivity, density, spec_heat, ready, assumptions, report, material
#
# Wire name, thickness_m, conductivity, density, spec_heat into Honeybee's "HB Opaque Material" component
# (_name_, _thickness, _conductivity, _density, _spec_heat). Units are already Honeybee's: m, W/m-K, kg/m3, J/kg-K.
# 'material' is a ready Honeybee EnergyMaterial when the honeybee-energy library can be imported here
# (otherwise null: use the HB Opaque Material component as above).
#
# ready = conductivity, density and specific heat all come from the paper (reported or calculated from its data,
# e.g. cp = conductivity / (density x diffusivity)). assumptions lists every value that does not.
# ============================================================================
import json
import re

cp_in = globals().get("cp")
allow_estimates = globals().get("allow_estimates")

rec = None
if best:
    d = json.loads(best)
    if isinstance(d, dict) and d.get("materials"):
        rec = d["materials"][0]
    elif isinstance(d, dict) and "name" in d:
        rec = d

P = (rec or {}).get("properties") or {}
B = (rec or {}).get("property_basis") or {}
OK = ("reported", "manual", "derived", "estimated") if allow_estimates else ("reported", "manual", "derived")
assumptions = []


def get(k):
    """value only if its basis is acceptable; estimated values are noted"""
    v = P.get(k)
    if v is None or B.get(k, "reported") not in OK:
        return None
    if B.get(k) == "estimated":
        assumptions.append("%s is an ESTIMATE, not from the paper" % k)
    return v


name = (rec or {}).get("name")
conductivity = get("thermal_conductivity_W_mK")
density = get("dry_density_kg_m3")
spec_heat = get("specific_heat_J_kgK")
from_paper = (None not in (conductivity, density, spec_heat) and not any(
    B.get(k) == "estimated" for k in ("thermal_conductivity_W_mK", "dry_density_kg_m3", "specific_heat_J_kgK")))
if spec_heat is None and cp_in is not None:
    spec_heat = float(cp_in)
    assumptions.append("specific heat %.0f J/kgK ASSUMED (your cp input), not from the paper" % spec_heat)
thickness_m = float(thickness) if thickness else None

ready = rec is not None and from_paper and thickness_m is not None

material = None
if rec is not None and None not in (conductivity, density, spec_heat, thickness_m):
    try:
        from honeybee_energy.material.opaque import EnergyMaterial
        ident = re.sub(r"[^A-Za-z0-9_\-]", "_", "%s_%s" % ((rec.get("id") or "earth"), name or ""))[:100]
        material = EnergyMaterial(ident, thickness_m, conductivity, density, spec_heat)
        material.display_name = name
    except ImportError:
        material = None

lines = []
if rec is None:
    lines.append("No material. Connect the 'best' output of component 4.")
else:
    r = ((rec.get("readiness") or {}).get("thermal") or {})
    lines.append("%s  (catalogue: thermal %s)" % (name, r.get("level", "no thermal data")))
    for label, v, unit in (("thickness", thickness_m, "m"), ("conductivity", conductivity, "W/m-K"),
                           ("density", density, "kg/m3"), ("spec_heat", spec_heat, "J/kg-K")):
        lines.append("  %-12s %s" % (label, "%s %s" % (v, unit) if v is not None else "MISSING"))
    if thickness_m is None:
        lines.append("  give the wall thickness in metres")
    if spec_heat is None:
        lines.append("  no specific heat in the paper: give a cp input (it will be listed as an assumption)")
    lines.append("READY for Honeybee" if ready else
                 ("Usable for Honeybee WITH assumptions" if None not in (conductivity, density, spec_heat, thickness_m)
                  else "NOT ready"))
    if assumptions:
        lines.append("Assumptions:")
        lines.extend("  - " + a for a in assumptions)
    if material is None and None not in (conductivity, density, spec_heat, thickness_m):
        lines.append("(honeybee-energy not importable here: wire the outputs into HB Opaque Material)")
report = "\n".join(lines)
# ---------- end thermal ----------
panel_41 = Panel(thermal.material)
panel_42 = Panel(thermal.name)
panel_43 = Panel(thermal.thickness_m)
panel_44 = Panel(thermal.conductivity)
panel_45 = Panel(thermal.density)
panel_46 = Panel(thermal.assumptions)
panel_47 = Panel(thermal.spec_heat)
panel_48 = Panel(thermal.ready)
panel_49 = Panel(thermal.report)

# ---- group: Where to build
item = ListItem(List=list_by_method.ids, Index=0, Wrap=True)
panel_50 = Panel(item)
where_to_build = Python3Script(json_text=fetch.json_text, material_id=panel_50, min_match=Slider(99, range=0..100), only_matching=Toggle(True))  # -> meshes, colors, legend, outlines, match, country, texture, countries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; inputs json_text: String, material_id: String, soil_map: String, min_match: Double, scale: Double, only_matching: Boolean
# ---------- where_to_build: Python ----------
# ============================================================================
# COMPONENT 8: WHERE CAN I BUILD THIS?  (reverse of component 4: material -> world map of matching soils)
#
# Inputs   json_text    str    Item   <- from component 1
#          material_id  str    Item   <- an id from component 3 (List Item on its 'ids'), e.g. "EM-..."
#          soil_map     str    Item (optional)  full path to data/soil_map.geojson; empty = SOIL_MAP_PATH below.
#                                        Made once with:  python "01_Soil Extraction/build_soil_map.py"
#          min_match    float  Item (optional)  areas at or above this count as buildable, default 80
#          scale        float  Item (optional)  model units per degree, default 1 (x = longitude, y = latitude)
#          only_matching bool  Item (optional)  True = draw only areas >= min_match (cleaner)
#          show_outlines bool  Item (optional)  True = also output every area boundary (slow: ~30,000 curves)
# Outputs  meshes, colors     one joined mesh per colour band, at most 5 (Custom Preview: meshes -> G, colors -> M)
#          legend             the band of each mesh, e.g. "90+ %"  (Legend component: colors -> C, legend -> T)
#          borders            country outlines, always drawn (from countries.geojson next to soil_map)
#          outlines           area boundaries as closed polylines (only with show_outlines), same order as match
#          match, country, region, texture   per drawn area (region = the main state / province / department in it)
#          countries, country_area_km2, country_best   countries ranked by buildable area (>= min_match)
#          regions, region_area_km2, region_best       TREES: branch {i} = the buildable regions of countries[i],
#                                                      largest first (regions from Natural Earth admin-1)
#          recipe, report
#
# Match = same score as component 4: both soils rescaled to clay+silt+sand = 100,
#         match = 100 - 0.5 x sum |difference|, so 80 means 20 % of the soil would have to be swapped.
# Soil = FAO DSMW topsoil, 1:5,000,000, dominant soil per unit: it shortlists regions, it does not
# replace testing the local soil. Texture only (no clay mineralogy, climate or additives).
# ============================================================================
import json
import os

import ghpythonlib.treehelpers as th
import scriptcontext as sc
import Rhino.Geometry as rg
from System.Collections.Generic import List
from System.Drawing import Color

SOIL_MAP_PATH = r"C:\Users\Asus\Desktop\MAA 02\Thesis\Workflow\02_Material Catalogue\earth-catalogue\data\soil_map.geojson"

soil_map = str(globals().get("soil_map") or "").strip() or SOIL_MAP_PATH
min_match = globals().get("min_match")
scale = globals().get("scale")
only_matching = globals().get("only_matching")
show_outlines = globals().get("show_outlines")
min_m = float(min_match) if min_match is not None else 80.0
k = float(scale) if scale else 1.0

# colour bands, same as the catalogue app: (lower bound, R, G, B, label)
BANDS = [(90, 26, 127, 55, "90+ %"), (80, 76, 175, 80, "80-89 %"), (70, 192, 216, 74, "70-79 %"),
         (60, 240, 180, 41, "60-69 %"), (-1, 231, 229, 228, "< 60 %")]

meshes, colors, legend, borders, outlines, match, country, region, texture = [], [], [], [], [], [], [], [], []
countries, country_area_km2, country_best = [], [], []
regions, region_area_km2, region_best = None, None, None
recipe, report = None, ""


def three(c, s, a):
    """rescale clay/silt/sand to sum to 100"""
    tot = float(c) + float(s) + float(a)
    if tot <= 0:
        return None
    return (c * 100.0 / tot, s * 100.0 / tot, a * 100.0 / tot)


def band_of(m):
    for i, b in enumerate(BANDS):
        if m >= b[0]:
            return i


def load_areas(path, k):
    """[(properties, clay/silt/sand rescaled, [(mesh, polyline), ...])] for every soil area.
    The geometry does not depend on the material, so it is built once and kept until the file or scale changes."""
    key = "earth_soil_areas"
    stamp = (path, os.path.getmtime(path), k)
    hit = sc.sticky.get(key)
    if hit and hit[0] == stamp:
        return hit[1]
    with open(path, "r") as f:
        data = json.load(f)
    areas = []
    for f in data["features"]:
        p = f["properties"]
        site = three(p["clay"], p["silt"], p["sand"])
        if site is None:
            continue
        parts = []
        for ring in rings(f["geometry"]):
            pl = rg.Polyline([rg.Point3d(x * k, y * k, 0) for x, y in ring])
            if pl.Count < 4:
                continue
            if not pl.IsClosed:
                pl.Add(pl[0])
            mesh = rg.Mesh.CreateFromClosedPolyline(pl)
            if mesh is not None:
                parts.append((mesh, pl))
        if parts:
            areas.append((p, site, parts))
    sc.sticky[key] = (stamp, areas)
    return areas


def load_borders(path, k):
    """country outlines as polyline curves, cached like the areas"""
    if not os.path.exists(path):
        return []
    key = "earth_country_borders"
    stamp = (path, os.path.getmtime(path), k)
    hit = sc.sticky.get(key)
    if hit and hit[0] == stamp:
        return hit[1]
    with open(path, "r") as f:
        data = json.load(f)
    curves = []
    for f in data["features"]:
        for ring in rings(f["geometry"]):
            if len(ring) >= 4:
                curves.append(rg.Polyline([rg.Point3d(x * k, y * k, 0) for x, y in ring]).ToPolylineCurve())
    sc.sticky[key] = (stamp, curves)
    return curves


def rings(geom):
    """outer rings of a Polygon / MultiPolygon (holes are skipped: lakes inside a soil area)"""
    if geom["type"] == "Polygon":
        return [geom["coordinates"][0]]
    if geom["type"] == "MultiPolygon":
        return [p[0] for p in geom["coordinates"]]
    return []


mats = json.loads(json_text).get("materials", []) if json_text else []
mat = next((m for m in mats if m.get("id") == str(material_id or "").strip()), None)
soil = (mat or {}).get("soil") or {}

if not json_text:
    report = "Connect json_text from component 1."
elif mat is None:
    report = "No material with id '%s'. Take an id from component 3." % material_id
elif not soil.get("match_ready"):
    report = "%s has no clay/silt/sand in its paper, so it cannot be matched to soils." % mat.get("name")
elif not soil_map or not os.path.exists(str(soil_map)):
    report = "soil_map file not found: %s\nBuild it with: python \"01_Soil Extraction/build_soil_map.py\"" % soil_map
else:
    recipe_t = three(soil["clay_pct"], soil["silt_pct"], soil["sand_pct"])
    recipe = "clay %.0f / silt %.0f / sand %.0f %%" % recipe_t
    borders = load_borders(os.path.join(os.path.dirname(str(soil_map)), "countries.geojson"), k)
    by_country = {}
    per_band = [[] for b in BANDS]
    for p, site, parts in load_areas(str(soil_map), k):
        mt = 100.0 - 0.5 * sum(abs(a - b) for a, b in zip(recipe_t, site))
        if mt >= min_m:
            c = by_country.setdefault(p["country"], [0.0, 0.0, {}])
            c[0] += p.get("sqkm") or 0
            c[1] = max(c[1], mt)
            for name, km2 in p.get("regions") or []:
                rr = c[2].setdefault(name, [0.0, 0.0])
                rr[0] += km2
                rr[1] = max(rr[1], mt)
        elif only_matching:
            continue
        per_band[band_of(mt)].extend(m for m, pl in parts)
        match.append(round(mt, 1))
        country.append(p["country"])
        region.append(p["regions"][0][0] if p.get("regions") else "")
        texture.append(p["texture"])
        if show_outlines:
            outlines.extend(pl.ToPolylineCurve() for m, pl in parts)
    n_drawn = len(match)

    # one joined mesh per band: a handful of objects for the preview instead of ~30,000
    for b, parts in zip(BANDS, per_band):
        if parts:
            joined = rg.Mesh()
            joined.Append(List[rg.Mesh](parts))
            meshes.append(joined)
            colors.append(Color.FromArgb(b[1], b[2], b[3]))
            legend.append(b[4])

    ranked = sorted(by_country.items(), key=lambda kv: -kv[1][0])
    countries = [c for c, v in ranked]
    country_area_km2 = [round(v[0]) for c, v in ranked]
    country_best = [round(v[1], 1) for c, v in ranked]
    reg = [sorted(v[2].items(), key=lambda kv: -kv[1][0]) for c, v in ranked]
    regions = th.list_to_tree([[n for n, rv in rs] for rs in reg])
    region_area_km2 = th.list_to_tree([[round(rv[0]) for n, rv in rs] for rs in reg])
    region_best = th.list_to_tree([[round(rv[1], 1) for n, rv in rs] for rs in reg])
    total = sum(country_area_km2)
    lines = ["%s  (%s)" % (mat.get("name"), ", ".join(mat.get("techniques") or [])),
             "Soil recipe (rescaled): " + recipe,
             "Buildable (match >= %.0f %%): %d countries, %.1f million km2" % (min_m, len(countries), total / 1e6)]
    for c, a, b, rs in list(zip(countries, country_area_km2, country_best, reg))[:10]:
        lines.append("  %-28s %8.0fk km2   best %.0f %%" % (c, a / 1e3, b))
        if rs:
            lines.append("      " + ", ".join("%s (%.0f %%)" % (n, rv[1]) for n, rv in rs[:5]) + (", ..." if len(rs) > 5 else ""))
    lines.append("%d areas drawn in %d colour bands. Texture only (DSMW topsoil): shortlist regions, then test the local soil."
                 % (n_drawn, len(meshes)))
    report = "\n".join(lines)
# ---------- end where_to_build ----------
dash = DashPattern(Curve=where_to_build.borders, Pattern=Slider(0.05, range=0..0.1))  # -> Dashes, Gaps
concat = Concatenate(FragmentA=where_to_build.countries, FragmentC=": ", FragmentB=where_to_build.country_best)
concat_2 = Concatenate(FragmentA=where_to_build.regions, FragmentC=": ", FragmentB=where_to_build.region_best)
preview = CustomPreview(Geometry=where_to_build.meshes, Material=where_to_build.colors)
legend = Legend(Colour=where_to_build.colors, Tags=where_to_build.legend, LegendType=1)
panel_51 = Panel(concat)
panel_52 = Panel(concat_2)
