# Grasshopper definition Soil Import component.gh (Grasshopper 1.0.8)

# ---- group: Location Picker
# Pick lets you pick the location without manually having to type in the lon and lat
button = Button()
location_picker = Python3Script(pick=button)  # -> lat, lon
# ---------- location_picker: Python ----------
import re
import Rhino
import scriptcontext as sc
import Eto.Forms as ef
import Eto.Drawing as ed

KEY = "soil_map_pick"

HTML = """
<!DOCTYPE html>
<html>
<head>
<meta charset="utf-8">
<title>map</title>
<link rel="stylesheet" href="https://cdnjs.cloudflare.com/ajax/libs/leaflet/1.9.4/leaflet.css"/>
<script src="https://cdnjs.cloudflare.com/ajax/libs/leaflet/1.9.4/leaflet.js"></script>
<style>
  html, body { margin:0; height:100%; font-family:Segoe UI, Arial, sans-serif; }
  #bar { height:48px; display:flex; align-items:center; gap:12px; padding:0 12px; background:#f0f0f0; }
  #map { height:calc(100% - 48px); }
  button { padding:6px 14px; font-size:14px; }
</style>
</head>
<body>
<div id="bar">
  <span id="info">Click on the map to place a marker</span>
  <button onclick="confirmPick()">Use this location</button>
</div>
<div id="map"></div>
<script>
  var map = L.map('map').setView([START_LAT, START_LON], START_ZOOM);
  L.tileLayer('https://server.arcgisonline.com/ArcGIS/rest/services/World_Imagery/MapServer/tile/{z}/{y}/{x}',
              {maxZoom: 18, attribution: 'Esri'}).addTo(map);
  var marker = null, pos = null;
  map.on('click', function(e) {
    pos = e.latlng;
    if (marker) { marker.setLatLng(pos); } else { marker = L.marker(pos).addTo(map); }
    document.getElementById('info').innerText =
      'lat ' + pos.lat.toFixed(5) + '   lon ' + pos.lng.toFixed(5);
  });
  function confirmPick() {
    if (!pos) { document.getElementById('info').innerText = 'Click the map first'; return; }
    document.title = 'PICK:' + pos.lat.toFixed(5) + ',' + pos.lng.toFixed(5);
  }
</script>
</body>
</html>
"""

def pick_location(lat0, lon0):
    result = {}
    if lat0 is not None and lon0 is not None:
        html = (HTML.replace("START_LAT", str(float(lat0)))
                    .replace("START_LON", str(float(lon0)))
                    .replace("START_ZOOM", "6"))
    else:
        html = (HTML.replace("START_LAT", "20")
                    .replace("START_LON", "0")
                    .replace("START_ZOOM", "2"))

    dlg = ef.Dialog()
    dlg.Title = "Pick a location"
    dlg.ClientSize = ed.Size(950, 700)
    dlg.Resizable = True

    web = ef.WebView()

    def on_title(sender, e):
        title = str(e.Title)
        if title.startswith("PICK:"):
            nums = re.findall(r"-?\d+\.?\d*", title)
            if len(nums) >= 2:
                result["lat"] = float(nums[0])
                result["lon"] = float(nums[1])
            dlg.Close()

    web.DocumentTitleChanged += on_title
    web.LoadHtml(html)
    dlg.Content = web
    dlg.ShowModal(Rhino.UI.RhinoEtoApp.MainWindow)

    if "lat" in result:
        return (result["lat"], result["lon"])
    return None

# Open the map when the button is pressed
if pick:
    picked = pick_location(lat0, lon0)
    if picked:
        sc.sticky[KEY] = picked

# Always output the last picked location
saved = sc.sticky.get(KEY)
if saved:
    lat, lon = saved
else:
    lat, lon = None, None
# ---------- end location_picker ----------

# ---- group: Soil Extraction
# Inputs: run, lat, lon
# Outputs: texture, bulk density, available water capacity, conductivity, hydrologic group, clay/silt/sand percentages, and the soil_valid flag
toggle = BooleanToggle(True)
soil_extraction = Python3Script(run=toggle, lat=location_picker.lat, lon=location_picker.lon)  # -> soil, texture, bd1, awc1, k1, hydgrp, clay1, silt1, sand1, soil_valid; inputs run: Boolean, lat: Double, lon: Double
# ---------- soil_extraction: Python ----------
import json
import urllib.request

SUPABASE_URL = "https://widpcrwshasvkaudybjv.supabase.co"
SUPABASE_KEY = "sb_publishable_nnucQOoiBqRPhgjhAAuEbQ_nQJMFkX-"

def fetch_soil(lat, lon):
    url = SUPABASE_URL + "/rest/v1/rpc/get_soil"
    headers = {
        "apikey": SUPABASE_KEY,
        "Content-Type": "application/json",
        "User-Agent": "soil-plugin",
    }
    if SUPABASE_KEY.startswith("eyJ"):
        headers["Authorization"] = "Bearer " + SUPABASE_KEY
    body = json.dumps({"lat": float(lat), "lon": float(lon)}).encode("utf-8")
    try:
        req = urllib.request.Request(url, data=body, headers=headers, method="POST")
        with urllib.request.urlopen(req, timeout=15) as resp:
            return json.loads(resp.read().decode("utf-8"))
    except Exception as e:
        print(f"Soil lookup error: {e}")
        return None

# Component Execution Logic
if run and lat is not None and lon is not None:
    data = fetch_soil(lat, lon)

    if data:
        texture = str(data.get("TEXTURE") or "N/A")
        bd1  = float(data.get("SOL_BD1") or 0.0)
        awc1 = float(data.get("SOL_AWC1") or 0.0)
        k1   = float(data.get("SOL_K1") or 0.0)
        hydgrp = str(data.get("HYDGRP") or "N/A")
        country = str(data.get("COUNTRY") or "N/A")
        clay1 = float(data.get("CLAY1") or 0.0)
        silt1 = float(data.get("SILT1") or 0.0)
        sand1 = float(data.get("SAND1") or 0.0)

        non_soil = texture in ("UWB", "N/A") or k1 >= 99
        soil_valid = not non_soil

        soil = f"Location: {country}\nTexture: {texture}\nHydgrp: {hydgrp}\nBulk Density: {bd1}"
    else:
        soil = "No soil polygon found at coordinates."
        texture, bd1, awc1, k1, hydgrp = "N/A", 0.0, 0.0, 0.0, "N/A"
        clay1, silt1, sand1 = 0.0, 0.0, 0.0
        soil_valid = False
else:
    soil = "Set 'run' to True and provide lat/lon."
    texture, bd1, awc1, k1, hydgrp = "N/A", 0.0, 0.0, 0.0, "N/A"
    clay1, silt1, sand1 = 0.0, 0.0, 0.0
    soil_valid = False
# ---------- end soil_extraction ----------
panel = Panel(soil_extraction.soil)
panel_2 = Panel(soil_extraction.bd1)
panel_3 = Panel(soil_extraction.texture)
panel_4 = Panel(soil_extraction.awc1)
panel_5 = Panel(soil_extraction.k1)
panel_6 = Panel(soil_extraction.hydgrp)
panel_7 = Panel(soil_extraction.clay1)
panel_8 = Panel(soil_extraction.silt1)
panel_9 = Panel(soil_extraction.sand1)
panel_10 = Panel(soil_extraction.soil_valid)

# ---- group: fetch
fetch = Python3Script(fetch=Button())  # -> json_text, status; inputs fetch: Boolean
# ---------- fetch: Python ----------
# ============================================================================
# COMPONENT 1: FETCH  (Rhino 7 GhPython or Rhino 8 Python 3 Script)
#
# Inputs   fetch  bool  Item   <- connect a Boolean Toggle or Button
#          url    str   Item   <- the "verified only" (or "everything") URL from the app's Settings tab
# Outputs  json_text  <- connect to components 2, 3 and 4
#          status
#
# Press the button: downloads the catalogue from Supabase and keeps a copy in memory and in
# a local cache file, so the other components keep working when you let go and after Rhino restarts.
# ============================================================================
import json, time
import scriptcontext as sc
from System.IO import File, Path
from System.Net import WebClient, ServicePointManager, SecurityProtocolType
from System.Text import Encoding

STICKY = "earth_catalogue_json"
CACHE = Path.Combine(Path.GetTempPath(), "earth_catalogue_cache.json")
CATALOGUE_URL = "https://widpcrwshasvkaudybjv.supabase.co/storage/v1/object/public/catalogue/earth_materials_catalogue_verified.json"


def describe(txt, prefix):
    d = json.loads(txt)
    return "%s: %d materials (exported %s)" % (prefix, len(d.get("materials", [])), str(d.get("exported_at", "?"))[:19])


json_text = sc.sticky.get(STICKY)
status = "Press the button to download the catalogue."
url = globals().get("url") or CATALOGUE_URL
try:
    if fetch:
        try:
            ServicePointManager.SecurityProtocol = SecurityProtocolType.Tls12   # needed on older .NET
        except Exception:
            pass
        wc = WebClient()
        wc.Encoding = Encoding.UTF8
        sep = "&" if "?" in url else "?"
        txt = wc.DownloadString(url + sep + "t=" + str(int(time.time())))     # t= defeats CDN caching
        d = json.loads(txt)
        if d.get("schema") != "earth_materials_catalogue":
            raise Exception("That URL did not return a catalogue export file.")
        sc.sticky[STICKY] = txt
        File.WriteAllText(CACHE, txt, Encoding.UTF8)
        json_text = txt
        status = describe(txt, "Downloaded")
    elif json_text:
        status = describe(json_text, "Using last download")
    elif File.Exists(CACHE):
        json_text = File.ReadAllText(CACHE, Encoding.UTF8)
        sc.sticky[STICKY] = json_text
        status = describe(json_text, "Loaded from local cache")
except Exception as e:
    status = "ERROR: " + str(e)
# ---------- end fetch ----------
panel_11 = Panel(fetch.json_text)
panel_12 = Panel(fetch.status)

# ---- group: decode
py3 = Python3Script(json_text=fetch.json_text)  # -> n, ids, names, techniques, methods_present, clay, decode, sand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
# ---------- py3: Python ----------
# ============================================================================
# COMPONENT 2: DECODE
#
# Inputs   json_text  str  Item   <- from component 1
# Outputs  n, ids, names, techniques, methods_present,
#          clay, silt, sand, gravel, texture, soil_source, match_ready,
#          rho, lam, cp, fc, ff, verified, doi, year
#
# Every list is in the same order: item 7 of 'names' goes with item 7 of 'lam', 'fc', 'clay', ...
# A missing value comes out as null. 'techniques' is the construction-method tag(s), e.g. "3d_printed".
# ============================================================================
import json

data = json.loads(json_text) if json_text else {}
mats = data.get("materials", [])


def prop(m, k):
    return (m.get("properties") or {}).get(k)


def soil(m, k):
    return (m.get("soil") or {}).get(k)


n = len(mats)
ids = [m.get("id") for m in mats]
names = [m.get("name") for m in mats]
techniques = [", ".join(m.get("techniques") or []) for m in mats]

counts = {}
for m in mats:
    for t in (m.get("techniques") or []):
        counts[t] = counts.get(t, 0) + 1
methods_present = ["%s (%d)" % (t, counts[t]) for t in sorted(counts)]

clay = [soil(m, "clay_pct") for m in mats]
silt = [soil(m, "silt_pct") for m in mats]
sand = [soil(m, "sand_pct") for m in mats]
gravel = [soil(m, "gravel_pct") for m in mats]
texture = [soil(m, "texture_class") for m in mats]
soil_source = [soil(m, "source") for m in mats]
match_ready = [bool(soil(m, "match_ready")) for m in mats]

rho = [prop(m, "dry_density_kg_m3") for m in mats]
lam = [prop(m, "thermal_conductivity_W_mK") for m in mats]
cp = [prop(m, "specific_heat_J_kgK") for m in mats]
fc = [prop(m, "compressive_strength_MPa") for m in mats]
ff = [prop(m, "flexural_strength_MPa") for m in mats]

verified = [bool(m.get("fully_verified")) for m in mats]
doi = [(m.get("source") or {}).get("doi") for m in mats]
year = [(m.get("source") or {}).get("year") for m in mats]
# ---------- end py3 ----------
panel_13 = Panel(py3.ids)
panel_14 = Panel(py3.names)
panel_15 = Panel(py3.techniques)
panel_16 = Panel(py3.sand)
panel_17 = Panel(py3.doi)
panel_18 = Panel(py3.clay)

# ---- group: list_by_method
list = ValueList({"3D printed": "3d_printed", "Cob": "cob", "Adobe": "adobe", "Rammed earth": "rammed_earth", "Compressed earth block": "compressed_earth_block", "Cast earth": "cast_earth", "Wattle and daub": "wattle_and_daub", "Earthbag": "earthbag", "Other": "other"}, selected="Adobe")
list_by_method = Python3Script(json_text=fetch.json_text, method=list)  # -> ids, names, techniques, clay, silt, sand, match_ready, rho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; inputs json_text: String, method: String, only_verified: Boolean
# ---------- list_by_method: Python ----------
# ============================================================================
# COMPONENT 3: LIST BY CONSTRUCTION METHOD
#
# Inputs   json_text  str  Item   <- from component 1
#          method     str  Item   <- from a Value List (see README): 3d_printed, cob, adobe, rammed_earth,
#                                    compressed_earth_block, cast_earth, wattle_and_daub, earthbag, other
#                                    leave empty or use "all" for no filter
#          only_verified  bool Item (optional)  True = only fully audited records
# Outputs  count, names, ids, techniques, lam, fc, rho, clay, silt, sand, match_ready, verified, doi, report
# ============================================================================
import json

# optional inputs may not exist on the component, or may be unconnected
only_verified = globals().get("only_verified")

data = json.loads(json_text) if json_text else {}
mats = data.get("materials", [])


def norm(t):
    return str(t or "").strip().lower().replace(" ", "_").replace("-", "_").replace("/", "_")


want = norm(method)
if want in ("", "all", "any"):
    want = None

picked = []
for m in mats:
    if want and want not in [norm(t) for t in (m.get("techniques") or [])]:
        continue
    if only_verified and not m.get("fully_verified"):
        continue
    picked.append(m)


def prop(m, k):
    return (m.get("properties") or {}).get(k)


def soil(m, k):
    return (m.get("soil") or {}).get(k)


count = len(picked)
names = [m.get("name") for m in picked]
ids = [m.get("id") for m in picked]
techniques = [", ".join(m.get("techniques") or []) for m in picked]
lam = [prop(m, "thermal_conductivity_W_mK") for m in picked]
fc = [prop(m, "compressive_strength_MPa") for m in picked]
rho = [prop(m, "dry_density_kg_m3") for m in picked]
clay = [soil(m, "clay_pct") for m in picked]
silt = [soil(m, "silt_pct") for m in picked]
sand = [soil(m, "sand_pct") for m in picked]
match_ready = [bool(soil(m, "match_ready")) for m in picked]
verified = [bool(m.get("fully_verified")) for m in picked]
doi = [(m.get("source") or {}).get("doi") for m in picked]

if not mats:
    report = "No catalogue loaded. Press the fetch button in component 1."
else:
    report = "%s: %d of %d materials%s. %d have a soil composition usable for matching, %d are fully verified." % (
        want or "all methods", count, len(mats), " (verified only)" if only_verified else "",
        sum(match_ready), sum(verified))
    if want and count == 0:
        present = sorted(set(norm(t) for m in mats for t in (m.get("techniques") or [])))
        report += " Methods in this catalogue: " + ", ".join(present)
# ---------- end list_by_method ----------
panel_19 = Panel(list_by_method.names)
panel_20 = Panel(list_by_method.techniques)
panel_21 = Panel(list_by_method.clay)
panel_22 = Panel(list_by_method.report)

# ---- group: match
list_2 = ValueList({"3D printed": "3d_printed", "Cob": "cob", "Adobe": "adobe", "Rammed earth": "rammed_earth", "Compressed earth block": "compressed_earth_block", "Cast earth": "cast_earth", "Wattle and daub": "wattle_and_daub", "Earthbag": "earthbag", "Other": "other"}, selected="Adobe")
match = Python3Script(
    json_text=fetch.json_text,
    method=list_2,
    site_clay=soil_extraction.clay1,
    site_silt=soil_extraction.silt1,
    site_sand=soil_extraction.sand1)  # -> best, names, ids, match_pct, texture, soil_source, lam, fc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; inputs json_text: String, method: String, site_clay: Double, site_silt: Double, site_sand: Double, only_verified: Boolean, min_fc: Double, max_lambda: Double, top_n: Int32
# ---------- match: Python ----------
# ============================================================================
# COMPONENT 4: MATCH SITE SOIL TO CATALOGUE
#
# Inputs   json_text   str    Item   <- from component 1
#          method      str    Item   <- construction method (same Value List as component 3)
#          site_clay   float  Item   <- the region's soil, % clay      (from your soil extraction: clay1)
#          site_silt   float  Item   <- % silt                          (silt1)
#          site_sand   float  Item   <- % sand                          (sand1)
#          only_verified bool  Item (optional)  True = only fully audited records
#          min_match   float  Item (optional)  hide matches below this % (e.g. 60)
#          min_fc      float  Item (optional)  discard materials weaker than this compressive strength (MPa)
#          max_lambda  float  Item (optional)  discard materials more conductive than this (W/m.K)
#          top_n       int    Item (optional)  how many to return, default 5
# Outputs  best, names, ids, match_pct, correction, texture, soil_source, lam, fc, rho, verified, doi, report
#
# best        the COMPLETE record of the best match as JSON text (same format as the catalogue file,
#             plus a "match" block with match_pct, correction and your site soil). Feed it to
#             component 5 (05_decode_best.py) to get every property, the recipe, curing, source...
#             Component 2 also reads it. It is empty (null) when nothing matched.
#             The other outputs are lists for the top_n results, closest first, lined up by position.
#
# match_pct   100 = the site soil is identical to the soil recipe in the paper.
#             Both soils are rescaled to clay+silt+sand = 100. The match is the share of the soil
#             that already agrees, so 60 means 40 % of the soil would have to be swapped.
#             Gravel is ignored. It compares soil texture only, not clay mineralogy or additives
#             (fibre, stabiliser, water), so use it to shortlist and then read the paper.
# correction  what to do to the site soil to reach that recipe, in percentage points of the soil,
#             e.g. "clay +3 / silt -10 / sand +7" (+ = needs more of it, - = needs less).
# ============================================================================
import json

# optional inputs may not exist on the component, or may be unconnected
only_verified = globals().get("only_verified")
min_match = globals().get("min_match")
min_fc = globals().get("min_fc")
max_lambda = globals().get("max_lambda")
top_n = globals().get("top_n")

data = json.loads(json_text) if json_text else {}
mats = data.get("materials", [])


def norm(t):
    return str(t or "").strip().lower().replace(" ", "_").replace("-", "_").replace("/", "_")


def three(c, s, a):
    """rescale clay/silt/sand to sum to 100"""
    tot = float(c) + float(s) + float(a)
    if tot <= 0:
        return None
    return (c * 100.0 / tot, s * 100.0 / tot, a * 100.0 / tot)


def prop(m, k):
    return (m.get("properties") or {}).get(k)


best, names, ids, match_pct, correction, texture, soil_source = None, [], [], [], [], [], []
lam, fc, rho, verified, doi = [], [], [], [], []
report = ""

site = None
if site_clay is not None and site_silt is not None and site_sand is not None:
    site = three(site_clay, site_silt, site_sand)

if not mats:
    report = "No catalogue loaded. Press the fetch button in component 1."
elif site is None:
    report = "Give the site's clay, silt and sand percentages."
else:
    want = norm(method)
    if want in ("", "all", "any"):
        want = None
    n_top = int(top_n) if top_n else 5
    drops = {"other method": 0, "no soil data": 0, "not verified": 0, "too weak": 0,
             "too conductive": 0, "below min match": 0}
    scored = []
    for m in mats:
        if want and want not in [norm(t) for t in (m.get("techniques") or [])]:
            drops["other method"] += 1
            continue
        s = m.get("soil") or {}
        if not s.get("match_ready"):
            drops["no soil data"] += 1
            continue
        if only_verified and not m.get("fully_verified"):
            drops["not verified"] += 1
            continue
        v_fc, v_lam = prop(m, "compressive_strength_MPa"), prop(m, "thermal_conductivity_W_mK")
        if min_fc is not None and (v_fc is None or v_fc < min_fc):
            drops["too weak"] += 1
            continue
        if max_lambda is not None and (v_lam is None or v_lam > max_lambda):
            drops["too conductive"] += 1
            continue
        t = three(s["clay_pct"], s["silt_pct"], s["sand_pct"])
        if t is None:
            drops["no soil data"] += 1
            continue
        delta = [a - b for a, b in zip(t, site)]            # change needed: site soil -> recipe soil
        match = 100.0 - 0.5 * sum(abs(x) for x in delta)    # 100 = identical
        if min_match is not None and match < min_match:
            drops["below min match"] += 1
            continue
        scored.append((match, delta, m))
    scored.sort(key=lambda x: -x[0])
    scored = scored[:n_top]

    names = [m.get("name") for mt, dl, m in scored]
    ids = [m.get("id") for mt, dl, m in scored]
    match_pct = [round(mt, 1) for mt, dl, m in scored]
    correction = ["clay %+d / silt %+d / sand %+d" % tuple(int(round(x)) for x in dl) for mt, dl, m in scored]
    texture = [(m.get("soil") or {}).get("texture_class") for mt, dl, m in scored]
    soil_source = [(m.get("soil") or {}).get("source") for mt, dl, m in scored]
    lam = [prop(m, "thermal_conductivity_W_mK") for mt, dl, m in scored]
    fc = [prop(m, "compressive_strength_MPa") for mt, dl, m in scored]
    rho = [prop(m, "dry_density_kg_m3") for mt, dl, m in scored]
    verified = [bool(m.get("fully_verified")) for mt, dl, m in scored]
    doi = [(m.get("source") or {}).get("doi") for mt, dl, m in scored]
    if scored:
        rec = dict(scored[0][2])
        rec["match"] = {"match_pct": match_pct[0], "correction": correction[0],
                        "site_clay": round(site[0], 1), "site_silt": round(site[1], 1), "site_sand": round(site[2], 1),
                        "method": want or "all"}
        best = json.dumps({"schema": data.get("schema"), "version": data.get("version"),
                           "count": 1, "materials": [rec]}, ensure_ascii=False)

    lines = ["Site soil (rescaled): clay %.0f / silt %.0f / sand %.0f %%" % site,
             "Method: %s" % (want or "all")]
    if scored:
        lines.append("Best: %s, %.0f%% match" % (names[0], match_pct[0]))
        lines.append("To reach its soil: %s (points of the soil)" % correction[0])
        if any(s_ == "computed_from_composition" for s_ in soil_source):
            lines.append("Note: some soil values were computed from the recipe, not measured soil. Check the source paper.")
    else:
        lines.append("No candidates left.")
    lines.append("Left out: " + ", ".join("%d %s" % (v, k) for k, v in drops.items() if v) if any(drops.values()) else "Nothing left out.")
    report = "\n".join(lines)
# ---------- end match ----------
panel_23 = Panel(match.best)
panel_24 = Panel(match.names)
panel_25 = Panel(match.match_pct)
panel_26 = Panel(match.correction)

# ---- group: decode_best
decode_best = Python3Script(best=match.best)  # -> fc, ft, ff, E, lam, cp, alpha, vhc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
# ---------- decode_best: Python ----------
# ============================================================================
# COMPONENT 5: DECODE THE BEST MATCH  ->  mechanical + thermal properties
#
# Input    best  str  Item   <- the 'best' output of component 4
#
# Outputs  each one is a single value (not a list), because it is one material. null = not reported in the paper.
#
#   WHICH        name, id, techniques, match_pct, correction, verified, doi
#   MECHANICAL   fc    compressive strength, MPa     ft   tensile strength, MPa
#                ff    flexural strength, MPa        E    elastic modulus, MPa
#   THERMAL      lam   conductivity, W/mK            cp   specific heat, J/kgK
#                alpha diffusivity, mm2/s            vhc  volumetric heat capacity, MJ/m3K
#                dec   decrement factor, -           lag  time lag, h
#   PHYSICAL     rho   dry density, kg/m3            por  porosity, %
#   HYGRIC       shr   drying shrinkage, %           wabs water absorption, %
#   SOIL         clay, silt, sand, gravel (% of the material's own soil), texture
#   CHECK        missing   the mechanical/thermal/physical properties that have no value for this material
#
# Poisson's ratio is not stored in the catalogue, so it is not available here.
# ============================================================================
import json

rec = None
if best:
    d = json.loads(best)
    if isinstance(d, dict) and d.get("materials"):
        rec = d["materials"][0]
    elif isinstance(d, dict) and "name" in d:
        rec = d

P = (rec or {}).get("properties") or {}
S = (rec or {}).get("soil") or {}
M = (rec or {}).get("match") or {}
SRC = (rec or {}).get("source") or {}

# ---- which
name = (rec or {}).get("name")
id = (rec or {}).get("id")
techniques = ", ".join((rec or {}).get("techniques") or [])
match_pct = M.get("match_pct")
correction = M.get("correction")
verified = bool((rec or {}).get("fully_verified"))
doi = SRC.get("doi")

# ---- mechanical
fc = P.get("compressive_strength_MPa")
ft = P.get("tensile_strength_MPa")
ff = P.get("flexural_strength_MPa")
E = P.get("elastic_modulus_MPa")

# ---- thermal
lam = P.get("thermal_conductivity_W_mK")
cp = P.get("specific_heat_J_kgK")
alpha = P.get("thermal_diffusivity_mm2_s")
vhc = P.get("volumetric_heat_capacity_MJ_m3K")
dec = P.get("decrement_factor")
lag = P.get("time_lag_h")

# ---- physical / hygric
rho = P.get("dry_density_kg_m3")
por = P.get("porosity_pct")
shr = P.get("shrinkage_pct")
wabs = P.get("water_absorption_pct")

# ---- soil
clay, silt, sand, gravel = S.get("clay_pct"), S.get("silt_pct"), S.get("sand_pct"), S.get("gravel_pct")
texture = S.get("texture_class")

# ---- which of the analysis properties are empty
wanted = [("fc", fc), ("ft", ft), ("ff", ff), ("E", E), ("lam", lam), ("cp", cp), ("alpha", alpha),
          ("vhc", vhc), ("dec", dec), ("lag", lag), ("rho", rho), ("por", por)]
missing = [k for k, v in wanted if v is None] if rec else ["No best match. Connect the 'best' output of component 4."]
# ---------- end decode_best ----------
panel_27 = Panel(decode_best.fc)
panel_28 = Panel(decode_best.ff)
panel_29 = Panel(decode_best.rho)
panel_30 = Panel(decode_best.shr)

# ----
panel_31 = Panel(decode_best.por)
